# Grasshopper definition El_combo.gh (Grasshopper 1.0.7)
# plug-ins: GraphicPlus, Heteroptera

file_path = FilePath("C:\Users\jaime\Downloads\florence_data.csv")
read_file = ReadFile(File=file_path, PerLineParse=True)
panel = Panel(read_file)
text_split = TextSplit(Text=read_file, Separators=",")
panel_2 = Panel(text_split)
file_path_2 = FilePath("C:\Users\jaime\Downloads\mapa de calor_variación temperatura 1880-2020 mensual - 1990-2020.csv")
file_path_3 = FilePath("C:\Users\jaime\Downloads\mapa de calor_variación temperatura 1880-2020 mensual - variación temperatura 1880-2020 mensual.csv")
split_list = SplitList(List=text_split, Index="1")  # -> ListA, ListB
panel_3 = Panel(split_list.ListB)
read_file_2 = ReadFile(File=file_path_3, PerLineParse=True)
panel_4 = Panel(read_file_2)
panel_5 = Panel(split_list.ListA)
text_split_2 = TextSplit(Text=read_file_2, Separators=",")
panel_6 = Panel(text_split_2)
flip_matrix = FlipMatrix(Data=split_list.ListB)
panel_7 = Panel(flip_matrix)

# ---- group: Rows Value
list_item = ListItem(List=text_split_2, Index="0", Wrap=True)
panel_8 = Panel(list_item)

# ----
cull_index = CullIndex(List=text_split_2, Indices="0", Wrap=True)
cull_index_2 = CullIndex(List=flatten(panel_5), Indices="0", Wrap=True)
panel_9 = Panel(cull_index)
explode_tree = ExplodeTree(Data=panel_9)  # -> _0000, _0010
number_slider = Slider(23, range=0..23)
cull_index_3 = CullIndex(List=flip_matrix, Indices="0", Wrap=True)
list_length = ListLength(List=explode_tree._0000)
cull_index_4 = CullIndex(List=flatten(panel_8), Indices="0", Wrap=True)
list_length_2 = ListLength(List=cull_index_3)  # -> flatten(Length)
delete_consecutive = DeleteConsecutive(Set=list_length_2, Wrap=False)  # -> Set, Count
construct_domain = ConstructDomain(DomainStart=0, DomainEnd=delete_consecutive.Set)
series = Series(Start="0", Step="1", Count=list_length)
bounds = Bounds(Numbers=series)
sub_list = SubList(List=flatten(cull_index), Domain=bounds, Wrap=True)  # -> List, Index
pi = Pi(Factor=Slider(0, range=0..2))
remap_numbers = RemapNumbers(Value=[Slider(0, range=0..1), Slider(1, range=0..1)], Source=Domain(0, 1), Target=construct_domain)  # -> graft(Mapped), Clipped
pi_2 = Pi(Factor=Slider(2, range=0..2))
pi_3 = Pi(Factor=1)
panel_10 = Panel(sub_list.List)
cull_index_5 = CullIndex(List=flatten(cull_index), Indices=sub_list.Index, Wrap=True)
panel_11 = Panel(cull_index_5)
explode_tree_2 = ExplodeTree(Data=remap_numbers.Mapped)  # -> Branch0, Branch1
list_normalizer = ListNormalizer(Numbers=series)
simplify_tree = SimplifyTree(Tree=graft(cull_index_4), Front=False)
construct_domain_2 = ConstructDomain(DomainStart=explode_tree_2.Branch0, DomainEnd=explode_tree_2.Branch1)
sub_list_2 = SubList(List=cull_index_2, Domain=construct_domain_2, Wrap=True)  # -> List, Index
list_length_3 = ListLength(List=sub_list_2.List)
sub_list_3 = SubList(List=cull_index_3, Domain=construct_domain_2, Wrap=True)  # -> List, Index
division = Division(A=sub_list_3.List, B=pi_3)
construct_domain_3 = ConstructDomain(DomainStart=pi_2, DomainEnd=pi)
divide_domain = DivideDomain(Domain=construct_domain_3, Count=list_length_3)
xy_plane = XYPlane(Origin=Point(0, 0, 0))
panel_12 = Panel(simplify_tree)
partition_list = PartitionList(List=panel_11, Size=list_length)
simplify_tree_2 = SimplifyTree(Tree=partition_list, Front=False)
list_normalizer_2 = ListNormalizer(Numbers=panel_11)
graph_mapper = GraphMapper(list_normalizer, x0=0, x1=1, y0=0, y1=1, container_name="Bezier", cpx=[0, 0.25, 0.75, 1], cpy=[0, 0.25, 0.75, 1])
square_root = SquareRoot(Value=division)
explode_tree_3 = ExplodeTree(Data=square_root)  # -> _000000, _001000, _002000, _003000, _004000, _005000, _006000
tree_statistics = TreeStatistics(Tree=simplify_tree_2)  # -> Paths, Length, Count
number_slider_2 = Slider(0.99, range=0..1)
list_length_4 = ListLength(List=tree_statistics.Paths)
addition = Addition(A=graph_mapper, B=Slider(0.47, range=0..1))
arc = Arc(Plane=PlaneXY(0, 0, 0), Radius=1, Angle=divide_domain)  # -> Arc, Length

# ---- group: InitialCircle
arc_2 = Arc(Plane=xy_plane, Radius=Slider(0.5, range=0..1), Angle=divide_domain)  # -> Arc, Length

# ----
list_length_5 = ListLength(List=arc_2.Arc)
number_slider_3 = Slider(100, range=0..140)
subtraction = Subtraction(A=list_length_4, B=number_slider_3)
arc_3 = Arc(Plane=PlaneXY(0, 0, 0), Radius=explode_tree_3._001000, Angle=divide_domain)  # -> Arc, Length
number_slider_4 = Slider(0.05, range=0..1)
subtraction_2 = Subtraction(A=subtraction, B=Slider(20, range=0..140))
arc_4 = Arc(Plane=PlaneXY(0, 0, 0), Radius=explode_tree_3._003000, Angle=divide_domain)  # -> Arc, Length
arc_5 = Arc(Plane=PlaneXY(0, 0, 0), Radius=explode_tree_3._002000, Angle=divide_domain)  # -> Arc, Length
series_2 = Series(Start=number_slider_3, Step="1", Count=subtraction_2)
tree_branch = TreeBranch(Tree=simplify_tree, Path=series_2, MaintainPaths=False)  # -> flatten(Branch)
list_length_6 = ListLength(List=tree_branch)
series_3 = Series(Start="0", Step="1", Count=list_length_6)
list_normalizer_3 = ListNormalizer(Numbers=series_3)
graph_mapper_2 = GraphMapper(
    list_normalizer_3,
    x0=0,
    x1=1,
    y0=0,
    y1=1,
    A=0.7666095533,
    B=0.1232776642,
    container_name="Linear",
    Graph_x0=0,
    Graph_x1=0.806579113,
    Graph_y0=0.1232776642,
    Graph_y1=0.7416089177)
panel_13 = Panel(graph_mapper_2)
arc_6 = Arc(Plane=PlaneXY(0, 0, 0), Radius=explode_tree_3._004000, Angle=divide_domain)  # -> Arc, Length
curve_middle = CurveMiddle(Curve=[arc_3.Arc, arc_5.Arc, arc_4.Arc, arc_6.Arc])
flip_matrix_2 = FlipMatrix(Data=curve_middle)
distance = Distance(PointA=flip_matrix_2, PointB=xy_plane)
bounds_2 = Bounds(Numbers=flatten(distance))
divide_domain_2 = DivideDomain(Domain=bounds_2, Count=Slider(8, range=0..10))
deconstruct_domain = DeconstructDomain(Domain=divide_domain_2)  # -> Start, End
line = Line(StartPoint=flip_matrix_2, EndPoint=xy_plane)
round = Round(Number=deconstruct_domain.End)  # -> Nearest, Floor, Ceiling
min_max = MinMax(Number=distance)  # -> Minimum, Maximum
panel_14 = Panel(distance)
circle = Circle(Plane=PlaneXY(0, 0, 0), Radius=round.Ceiling)
panel_15 = Panel(min_max.Maximum)
list_length_7 = ListLength(List=circle)
bounds_3 = Bounds(Numbers=panel_13)
vector_xyz = VectorXYZ(XComponent=Slider(0, range=0..100), YComponent=addition, ZComponent=0)  # -> Vector, Length
point = Point(vector_xyz.Vector)
list_item_2 = ListItem(List=circle, Index=expr("x-1", list_length_7), Wrap=True)
divide_curve = DivideCurve(Curve=list_item_2, Count=list_length_5, Kinks=False)  # -> Points, Tangents, Parameters
equality = Equality(FirstNumber=panel_15, SecondNumber=panel_14)  # -> Equality, Inequality
number_slider_5 = Slider(2, range=0..10)
number_slider_6 = Slider(10, range=0..10)
weave = Weave(Pattern=[0, 1], Stream0=arc_3.Arc, Stream1=arc_2.Arc, NullGaps=False)
subtraction_3 = Subtraction(A="1", B=number_slider_4)
center = Center(Geometric=circle)  # -> Center, Dimension
panel_16 = Panel(equality.Equality)
tree_branch_2 = TreeBranch(Tree=simplify_tree_2, Path=series_2, MaintainPaths=False)
panel_17 = Panel(tree_branch_2)
addition_2 = Addition(A=tree_branch_2, B=number_slider_2)
line_2 = Line(StartPoint=divide_curve.Points, EndPoint=center.Center)
relay = Relay([circle, line_2])
panel_18 = Panel("-1")
construct_domain_4 = ConstructDomain(DomainStart=subtraction_3, DomainEnd=number_slider_4)
remap_numbers_2 = RemapNumbers(Value=graph_mapper_2, Source=bounds_3, Target=construct_domain_4)  # -> Mapped, Clipped
pi_4 = Pi(Factor=expr("x*2", remap_numbers_2.Mapped))  # -> graft(Output)
rotate_3d = Rotate3D(Geometry=point, Angle=pi_4, Center=Point(0, 0, 0), Axis=Vector(0, 0, 1))  # -> Geometry, Transform
partition_list_2 = PartitionList(List=weave, Size=number_slider_5)
weave_2 = Weave(Pattern=[0, 1], Stream0=arc_4.Arc, Stream1=arc_2.Arc, NullGaps=False)
weave_3 = Weave(Pattern=[0, 1], Stream0=arc_5.Arc, Stream1=arc_2.Arc, NullGaps=False)
weave_4 = Weave(Pattern=[0, 1], Stream0=arc_6.Arc, Stream1=arc_2.Arc, NullGaps=False)
bounds_4 = Bounds(Numbers=flatten(addition_2))
cull_pattern = CullPattern(List=line, CullPattern=panel_16)
length = Length(Curve=cull_pattern)
partition_list_3 = PartitionList(List=weave_2, Size=number_slider_5)
partition_list_4 = PartitionList(List=weave_3, Size=number_slider_5)
degrees = Degrees(Radians=pi_4)  # -> flatten(Degrees)
loft = Loft(
    Curves=partition_list_2,
    Options={Adjust=False, Closed=False, LoftEnds=0, LoftSimp=0, LoftType=0, Rebuild=10, Refit=0.01})
partition_list_5 = PartitionList(List=weave_4, Size=number_slider_5)
null_item = NullItem(Item=loft)  # -> NullFlags, InvalidFlags, Description
scale = Scale(Geometry=rotate_3d.Geometry, Center=Point(0, 0, 0), Factor=Slider(25, range=0..100))  # -> Geometry, Transform
divide_domain_3 = DivideDomain(Domain=bounds_4, Count=Slider(6, range=0..10))
end_points = EndPoints(Curve=cull_pattern)  # -> Start, End
random = Random(Range=Domain(0, 1), Number=Slider(10, range=0..10), Seed=2)
deconstruct_domain_2 = DeconstructDomain(Domain=divide_domain_3)  # -> Start, End
maximum = Maximum(A=length, B=Slider(10, range=0..10))
vector_2pt = Vector2Pt(PointA=end_points.End, PointB=end_points.Start, Unitize=Toggle(True))  # -> Vector, Length
circle_2 = Circle(Plane=scale.Geometry, Radius=addition_2)
panel_19 = Panel(circle_2)
loft_2 = Loft(
    Curves=partition_list_3,
    Options={Adjust=False, Closed=False, LoftEnds=0, LoftSimp=0, LoftType=0, Rebuild=10, Refit=0.01})
loft_3 = Loft(
    Curves=partition_list_4,
    Options={Adjust=False, Closed=False, LoftEnds=0, LoftSimp=0, LoftType=0, Rebuild=10, Refit=0.01})
cull_pattern_2 = CullPattern(List=loft, CullPattern=invert(null_item.NullFlags))
null_item_2 = NullItem(Item=loft_2)  # -> NullFlags, InvalidFlags, Description
null_item_3 = NullItem(Item=loft_3)  # -> NullFlags, InvalidFlags, Description
loft_4 = Loft(
    Curves=partition_list_5,
    Options={Adjust=False, Closed=False, LoftEnds=0, LoftSimp=0, LoftType=0, Rebuild=10, Refit=0.01})
null_item_4 = NullItem(Item=loft_4)  # -> NullFlags, InvalidFlags, Description
min_max_2 = MinMax(Number=degrees)  # -> Minimum, Maximum
line_sdl = LineSDL(Start=xy_plane, Direction=vector_2pt.Vector, Length=maximum)
number_slider_7 = Slider(10, range=0..10)
panel_20 = Panel(deconstruct_domain_2.End)
circle_3 = Circle(Plane=PlaneXY(0, 0, 0), Radius=deconstruct_domain_2.End)
deconstruct_arc = DeconstructArc(Arc=circle_3)  # -> BasePlane, Radius, Angle
multiplication = Multiplication(A=deconstruct_arc.Radius, B=Slider(1, range=0..10))
list_length_8 = ListLength(List=circle_3)
cull_pattern_3 = CullPattern(List=loft_2, CullPattern=invert(null_item_2.NullFlags))
cull_pattern_4 = CullPattern(List=loft_3, CullPattern=invert(null_item_3.NullFlags))
cull_pattern_5 = CullPattern(List=loft_4, CullPattern=invert(null_item_4.NullFlags))
multiplication_2 = Multiplication(A=random, B=Slider(10, range=0..1000))
unit_z = UnitZ(Factor=multiplication_2)
multiplication_3 = Multiplication(A=deconstruct_arc.Radius)
data = Data(sub_list_2.List)
consecutive_domains = ConsecutiveDomains(Numbers=multiplication, Additive=True)
subtraction_4 = Subtraction(A=min_max_2.Maximum, B=min_max_2.Minimum)
end_points_2 = EndPoints(Curve=line_sdl)  # -> Start, End
addition_3 = Addition(A=multiplication_3)
point_2 = Point(end_points_2.End)
xy_plane_2 = XYPlane(Origin=point_2)
align_plane = AlignPlane(Plane=xy_plane_2, Direction=vector_2pt.Vector)  # -> Plane, Angle
panel_21 = Panel(subtraction_4)
multiplication_4 = Multiplication(A=panel_20, B=number_slider_7)
number_slider_8 = Slider(0, range=0..100)
deconstruct_domain_3 = DeconstructDomain(Domain=consecutive_domains)  # -> Start, End
scale_2 = Scale(Geometry=circle_2, Center=Point(0, 0, 0), Factor=Slider(1, range=0..1))  # -> Geometry, Transform
round_2 = Round(Number=multiplication_4)  # -> Nearest, Floor, Ceiling
pi_5 = Pi(Factor=Slider(1.5, range=0..2))
rotate_plane = RotatePlane(Plane=align_plane.Plane, Angle=pi_5)
division_2 = Division(A=round_2.Nearest, B=number_slider_7)
list_item_3 = ListItem(List=deconstruct_domain_3.Start, Index=number_slider_8, Wrap=True)
merge = Merge(Data1=cull_pattern_2, Data2=cull_pattern_4, Data3=cull_pattern_3, Data4=cull_pattern_5)  # -> flatten(Result)
list_normalizer_4 = ListNormalizer(Numbers=tree_branch_2)  # -> flatten(Numbers)
number_slider_9 = Slider(1, range=0..1)
number_slider_10 = Slider(0, range=0..100)
area = Area(Geometry=scale_2.Geometry)  # -> Area, Centroid
flip_matrix_3 = FlipMatrix(Data=area.Centroid)
insert_items = InsertItems(List=deconstruct_domain_3.End, Item=list_item_3, Indices=number_slider_8, Wrap=True)
unit_x = UnitX(Factor=insert_items)
move = Move(Geometry=circle_3, Motion=unit_x)  # -> Geometry, Transform
construct_domain_5 = ConstructDomain(DomainStart="1", DomainEnd="0")
area_2 = Area(Geometry=merge)  # -> flatten(Area), Centroid
list_normalizer_5 = ListNormalizer(Numbers=insert_items)  # -> flatten(Numbers)
remap_numbers_3 = RemapNumbers(Value=list_normalizer_4, Source=Domain(0, 1), Target=construct_domain_5)  # -> Mapped, Clipped
divide_domain_4 = DivideDomain(Domain=Domain(0, 1), Count=Slider(4, range=0..10))
deconstruct_domain_4 = DeconstructDomain(Domain=divide_domain_4)  # -> Start, End
boundary_surfaces = BoundarySurfaces(Edges=move.Geometry, UseTasks=False)
interpolate = Interpolate(Vertices=flip_matrix_3, Degree=3, Periodic=False, KnotStyle=1)  # -> Curve, Length, Domain
number_slider_11 = Slider(1, range=0..1)
gradient = Gradient(
    LowerLimit=number_slider_9,
    UpperLimit=number_slider_10,
    Parameter=remap_numbers_3.Mapped,
    stops=[0: RGB(255, 255, 255), 0.2: RGB(3, 39, 90), 0.4: RGB(26, 125, 215), 0.6: RGB(242, 184, 9), 0.8: RGB(243, 116, 2)])
interpolate_2 = Interpolate(Vertices=area.Centroid, Degree=3, Periodic=False, KnotStyle=1)  # -> Curve, Length, Domain
vector_xyz_2 = VectorXYZ(XComponent=Slider(-5.63, range=-100..100), YComponent=Slider(0, range=-100..100), ZComponent=0)  # -> Vector, Length
move_2 = Move(Geometry=boundary_surfaces, Motion=vector_xyz_2.Vector)  # -> Geometry, Transform
gradient_2 = Gradient(LowerLimit=0, UpperLimit=1, Parameter=deconstruct_domain_4.End, stops=[0: RGB(255, 255, 255), 1: RGB(0, 0, 0)])
panel_22 = Panel(gradient)
construct_domain_6 = ConstructDomain(DomainStart="1", DomainEnd="0")
remap_numbers_4 = RemapNumbers(Value=list_normalizer_5, Source=Domain(0, 1), Target=construct_domain_6)  # -> Mapped, Clipped
gradient_3 = Gradient(
    LowerLimit=number_slider_9,
    UpperLimit=number_slider_10,
    Parameter=remap_numbers_4.Mapped,
    stops=[0: RGB(3, 39, 90), 0.2: RGB(3, 39, 90), 0.4: RGB(26, 125, 215), 0.6: RGB(242, 184, 9), 0.8: RGB(243, 116, 2)])
end_points_3 = EndPoints(Curve=interpolate_2.Curve)  # -> Start, End
extend_curve = ExtendCurve(Curve=interpolate_2.Curve, Type=0, Start=number_slider_11, End=number_slider_11)
panel_23 = Panel(gradient_2)
explode_tree_4 = ExplodeTree(Data=graft(panel_23))  # -> Branch0, Branch1, Branch2, Branch3
rotate = Rotate(Geometry=move_2.Geometry, Angle=1.570796327, Plane=PlaneXY(0, 0, 0))  # -> Geometry, Transform
pi_6 = Pi(Factor=Slider(2, range=0..2))
pi_7 = Pi(Factor=Slider(1, range=0..2))
vector_2pt_2 = Vector2Pt(PointA=end_points_3.Start, PointB=end_points_3.End, Unitize=Toggle(False))  # -> Vector, Length
align_plane_2 = AlignPlane(Plane=end_points_3.End, Direction=vector_2pt_2.Vector)  # -> Plane, Angle
list_length_9 = ListLength(List=flatten(align_plane_2.Plane))
unit_x_2 = UnitX(Factor=Slider(1.62, range=0..10))
solid_fill = SolidFill(ShapeGeometry=cull_pattern_2, Color=explode_tree_4.Branch0)
end_points_4 = EndPoints(Curve=interpolate.Curve)  # -> Start, End
solid_fill_2 = SolidFill(ShapeGeometry=cull_pattern_4, Color=explode_tree_4.Branch1)
split_list_2 = SplitList(List=flatten(align_plane_2.Plane), Index=expr("x/2", list_length_9))  # -> ListA, ListB
solid_fill_3 = SolidFill(ShapeGeometry=loft_2, Color=explode_tree_4.Branch2)
point_3 = Point(end_points_4.End)
move_3 = Move(Geometry=point_3, Motion=unit_x_2)  # -> Geometry, Transform
create_material = CreateMaterial(Diffuse=gradient_3, Specular=RGB(255, 255, 255), Emission=RGB(0, 0, 0), Transparency=Slider(0.28, range=0..1), Shine=0)
rotate_plane_2 = RotatePlane(Plane=split_list_2.ListA, Angle=pi_6)
rotate_plane_3 = RotatePlane(Plane=split_list_2.ListB, Angle=pi_7)
solid_fill_4 = SolidFill(ShapeGeometry=cull_pattern_5, Color=explode_tree_4.Branch3)
list_length_10 = ListLength(List=tree_branch)
merge_2 = Merge(Data1=rotate_plane_2, Data2=rotate_plane_3)  # -> graft(Result)
custom_preview = CustomPreview(Geometry=move_2.Geometry, Material=create_material)
scale_3 = Scale(Geometry=rotate_plane, Center=Point(0, 0, 0), Factor=Slider(1.06, range=0..10))  # -> Geometry, Transform
scale_4 = Scale(Geometry=merge_2, Center=Point(0, 0, 0), Factor=Slider(0.23, range=0..10))  # -> Geometry, Transform
series_4 = Series(Start=0, Step=1, Count=list_length_10)
merge_3 = Merge(Data1=solid_fill, Data2=solid_fill_2, Data3=solid_fill_3, Data4=solid_fill_4)  # -> flatten(Result)
sort_list = SortList(Keys=area_2.Area, ValuesValuesA=merge_3)  # -> Keys, ValuesValuesA
replace_items = ReplaceItems(List=series_4, Indices=series_4, Wrap=False)
reverse_list = ReverseList(List=sort_list.ValuesValuesA)
modulus = Modulus(A=series_4, B=Slider(10, range=0..10))
panel_24 = Panel(sort_list.ValuesValuesA)
number_slider_12 = Slider(0.5, range=0..1)
colour_picker = ColourPicker(PickedColour=RGB(255, 255, 255))
equality_2 = Equality(FirstNumber=Slider(0, range=0..100), SecondNumber=modulus)  # -> Equality, Inequality
cull_pattern_6 = CullPattern(List=tree_branch, CullPattern=equality_2.Equality)
text_shape = TextShape(Text=data, Plane=flatten(rotate_plane))
item_index = ItemIndex(List=tree_branch, Item=cull_pattern_6)
replace_items_2 = ReplaceItems(List=replace_items, Item=cull_pattern_6, Indices=item_index, Wrap=False)
stroke = Stroke(ShapeGeometry=reverse_list, Color=colour_picker, Weight=number_slider_12, EndCap=0)
replace_nulls = ReplaceNulls(Items=replace_items_2, Replacements=" ")  # -> Items, Count
relay_2 = Relay()
number_slider_13 = Slider(386, range=0..1000)
stroke_2 = Stroke(ShapeGeometry=flatten(relay), Color=colour_picker, Weight=number_slider_12, EndCap=0)
colour_picker_2 = ColourPicker(PickedColour=RGB(128, 106, 106))
font = Font(
    TextShape=text_shape,
    FontFamily="Segoe UI",
    FontSize=Slider(11, range=0..100),
    Bold=False,
    Italic=False,
    Underline=False,
    Justification=Slider(1, range=0..10))
number_slider_14 = Slider(1000, range=0..1000)
split_ahsl = SplitAHSL(Colour=gradient_3)  # -> Alpha, Hue, Saturation, Luminance
split_ahsl_2 = SplitAHSL(Colour=panel_22)  # -> Alpha, Hue, Saturation, Luminance
number_slider_15 = Slider(0.5, range=0..1)
merge_4 = Merge(Data1=font, Data2=stroke, Data3=stroke_2)  # -> flatten(Result)
number_slider_16 = Slider(9, range=0.1..10)
text_shape_2 = TextShape(Text=graft(panel_10), Plane=move_3.Geometry)  # -> flatten(TextShape)
text_shape_3 = TextShape(Text=graft(replace_nulls.Items), Plane=scale_4.Geometry)  # -> flatten(TextShape)
stroke_3 = Stroke(ShapeGeometry=[interpolate.Curve, extend_curve], Color=colour_picker_2, Weight=1, EndCap=0)  # -> flatten(Shape)
colour_hsl = ColourHSL(Alpha=number_slider_15, Hue=split_ahsl.Hue, Saturation=split_ahsl.Saturation, Luminance=split_ahsl.Luminance)
colour_hsl_2 = ColourHSL(Alpha=number_slider_15, Hue=split_ahsl_2.Hue, Saturation=split_ahsl_2.Saturation, Luminance=split_ahsl_2.Luminance)
file_path_4 = FilePath("C:\Users\jaime\OneDrive\Documents\DATA_VIZ\Investigacion\Exportacion_rhino\")
construct_drawing = ConstructDrawing(ShapesGeometry=merge_4, Width=number_slider_14, Height=number_slider_14, Color=RGBA(255, 255, 255, 0))  # -> Drawing, Boundary
create_material_2 = CreateMaterial(Diffuse=panel_22, Specular=RGB(255, 255, 255), Emission=RGB(0, 0, 0), Transparency=Slider(0.28, range=0..1), Shine=0)
solid_fill_5 = SolidFill(ShapeGeometry=rotate.Geometry, Color=colour_hsl)
boundary_surfaces_2 = BoundarySurfaces(Edges=scale_2.Geometry, UseTasks=False)
font_2 = Font(
    TextShape=text_shape_3,
    FontFamily="Segoe UI",
    FontSize=number_slider_16,
    Bold=False,
    Italic=False,
    Underline=False,
    Justification=Slider(4, range=0..10))
font_3 = Font(
    TextShape=text_shape_2,
    FontFamily="Segoe UI",
    FontSize=number_slider_16,
    Bold=False,
    Italic=False,
    Underline=False,
    Justification=0)
save_svg = SaveSvg(DrawingsShapesGeometry=construct_drawing.Drawing, FolderPath=file_path_4, FileName="Nightingalemain", Save=Toggle(False))
button = Button()
custom_preview_2 = CustomPreview(Geometry=flatten(boundary_surfaces_2), Material=create_material_2)
solid_fill_6 = SolidFill(ShapeGeometry=flatten(boundary_surfaces_2), Color=colour_hsl_2)
center_2 = Center(Geometric=rotate.Geometry)  # -> Center, Dimension
cull_index_6 = CullIndex(List=solid_fill_5, Indices="0", Wrap=True)
unit_x_3 = UnitX(Factor=Slider(-1, range=-1..1))
stroke_4 = Stroke(ShapeGeometry=[solid_fill_6, cull_index_6], Color=RGB(0, 0, 0), Weight=Slider(0, range=0..100), EndCap=0)
move_4 = Move(Geometry=center_2.Center, Motion=unit_x_3)  # -> Geometry, Transform
subtraction_5 = Subtraction(A=division_2, B=number_slider_2)
number_slider_17 = Slider(500, range=0..1000)
text_shape_4 = TextShape(Text=subtraction_5, Plane=move_4.Geometry)
cull_index_7 = CullIndex(List=text_shape_4, Indices="0", Wrap=True)
font_4 = Font(
    TextShape=cull_index_7,
    FontFamily="Segoe UI",
    FontSize=Slider(5, range=0..10),
    Bold=False,
    Italic=False,
    Underline=False,
    Justification=Slider(5, range=0..10))
merge_5 = Merge(Data2=font_2, Data3=font_3, Data6=stroke_3, Data7=stroke_4, Data8=font_4)
construct_drawing_2 = ConstructDrawing(ShapesGeometry=flatten(merge_5), Width=number_slider_17, Height=number_slider_17, Color=RGBA(255, 255, 255, 0))  # -> Drawing, Boundary
drawing_viewer = DrawingViewer(DrawingsShapesGeometry=construct_drawing_2.Drawing, Resolution=Slider(1000, range=0..1000))
file_path_5 = FilePath("C:\Users\jaime\OneDrive\Documents\DATA_VIZ\Investigacion\Exportacion_rhino\")
save_svg_2 = SaveSvg(
    DrawingsShapesGeometry=construct_drawing_2.Drawing,
    FolderPath=file_path_5,
    FileName="Half_a_Graph_with_text_2",
    Save=Toggle(False))
drawing_viewer_2 = DrawingViewer(DrawingsShapesGeometry=construct_drawing.Drawing, Resolution=Slider(1000, range=0..1000))
